# Grasshopper definition ConvertCoords.gh (Grasshopper 1.0.7)
# plug-ins: BH.UI.Grasshopper

node = Node(Latitude="53.340167", Longitude="-6.266531", Component="{ .Node")
toutmpoint = ToUTMPoint(Node=node, Component="{ .ToUTMPoint")
latlontoutm = LatLonToUTM(Lat="53.340167", Lon="-6.266531", Component="{ .LatLonToUTM")
# Look up utm zone: http://www.dmap.co.uk/utmworld.htm
pdecon = Deconstruct(Point=toutmpoint)  # -> XComponent, YComponent, ZComponent
panel = Panel(latlontoutm)
panel_2 = Panel(pdecon.XComponent)
panel_3 = Panel(pdecon.YComponent)
longitudetoutmzone = LongitudeToUTMZone(Longitude="-6.266531", Component="{ .LongitudeToUTMZone")
utmtolatlon = UTMtoLatLon(Easting=panel_2, Northing=panel_3, Zone=longitudetoutmzone, SouthernHemi=Toggle(False), Component="{ .UTMtoLatLon")
panel_4 = Panel(utmtolatlon)
