# Grasshopper definition FindElementByID.gh (Grasshopper 1.0.7)
# plug-ins: BH.UI.Grasshopper

createdictionary = CreateDictionary(Component="{ .CreateDictionary")
relation = Relation(Keyvalues=createdictionary, Component="BH.oM.OpenStreetMap.Relation")
querybuilder = QueryBuilder(OsmID="62273", Element=relation, Component="{ .QueryBuilder")
explode = Explode(Object=querybuilder, Component="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")  # -> QueryString, BHoM_Guid, Name, Fragments, Tags, CustomData
panel = Panel(explode.QueryString)
getrequest = GetRequest(Uri=explode.QueryString, Component="{ .GetRequest")  # disabled
toelementcontainer = ToElementContainer(OpenStreetMapQueryJSONResult=getrequest, Component="{ .ToElementContainer")
explode_2 = Explode(Object=toelementcontainer, Component="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")  # -> Nodes, Ways, BHoM_Guid, Name, Fragments, Tags, CustomData
