# Grasshopper definition SearchAlongLineString.gh (Grasshopper 1.0.7)
# plug-ins: BH.UI.Grasshopper

# Pubs and roads within 200m of the route home
panel = Panel("""53.33413
53.33413
53.33413
53.33403
53.334
53.33393
53.33386
53.33369
53.33347
53.33301
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""")
panel_2 = Panel("""-6.26623
-6.26532
-6.26529
-6.26527
-6.26525
-6.26522
-6.26522
-6.26517
-6.26508
-6.26497
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""")
createdictionary = CreateDictionary(Keys="highway", Component="{ .CreateDictionary")
createdictionary_2 = CreateDictionary(Keys="amenity", Values="bar", Component="{ .CreateDictionary")
createdictionary_3 = CreateDictionary(Keys="amenity", Values="pub", Component="{ .CreateDictionary")
node = Node(Latitude=panel, Longitude=panel_2, Component="BH.oM.OpenStreetMap.Node")
polygon = Polygon(Nodes=node, Component="BH.oM.OpenStreetMap.Polygon")
way = Way(Keyvalues=createdictionary, Component="BH.oM.OpenStreetMap.Way")
toutmpoint = ToUTMPoint(Node=node, Component="{ .ToUTMPoint")
linestringradius = LineStringRadius(Radius=Slider(200, range=0..1000), Polygon=polygon, Component="BH.oM.OpenStreetMap.LineStringRadius")
node_2 = Node(Keyvalues=[createdictionary_3, createdictionary_2], Component="BH.oM.OpenStreetMap.Node")
point = Point(toutmpoint)
polyline = PolyLine(Vertices=point, Closed=False)
querybuilder = QueryBuilder(Region=linestringradius, Elements=node_2, Component="{ .QueryBuilder")
querybuilder_2 = QueryBuilder(Region=linestringradius, Elements=way, Component="{ .QueryBuilder")
explode = Explode(Object=querybuilder, Component="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")  # -> QueryString, BHoM_Guid, Name, Fragments, Tags, CustomData
explode_2 = Explode(Object=querybuilder_2, Component="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")  # -> QueryString, BHoM_Guid, Name, Fragments, Tags, CustomData

# ----
# ENABLE ONE BY ONE TO QUERY
getrequest = GetRequest(Uri=explode_2.QueryString, Component="{ .GetRequest")  # disabled
getrequest_2 = GetRequest(Uri=explode.QueryString, Component="{ .GetRequest")  # disabled

toelementcontainer = ToElementContainer(OpenStreetMapQueryJSONResult=getrequest_2, Component="{ .ToElementContainer")
toelementcontainer_2 = ToElementContainer(OpenStreetMapQueryJSONResult=getrequest, Component="{ .ToElementContainer")
explode_3 = Explode(Object=toelementcontainer_2, Component="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")  # -> Nodes, Ways, BHoM_Guid, Name, Fragments, Tags, CustomData
explode_4 = Explode(Object=toelementcontainer, Component="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")  # -> Nodes, Ways, BHoM_Guid, Name, Fragments, Tags, CustomData
toutmpoint_2 = ToUTMPoint(Node=explode_4.Nodes, Component="{ .ToUTMPoint")
toutmpolyline = ToUTMPolyline(Way=explode_3.Ways, Component="{ .ToUTMPolyline")
explode_5 = Explode(Object=explode_4.Nodes, Component="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")  # -> Latitude, Longitude, OsmID, KeyValues, BHoM_Guid, Name, Fragments, Tags, CustomData
point_2 = Point(toutmpoint_2)
getproperty = GetProperty(Obj=explode_5.KeyValues, PropName="name", Component="{ .GetProperty")
text_tag_3d = TextTag3D(Location=point_2, Text=getproperty, Size=Slider(39, range=0..1000), Justification=7)
