# Grasshopper definition SearchBoundingBox.gh (Grasshopper 1.0.7)
# plug-ins: BH.UI.Grasshopper

# Stadiums in OSM are often Relations with the inner and outer roof lines
panel = Panel("leisure")
# Searching within Bounding Box around Tottenham Hotspur
# Good place for the boundary values is https://www.openstreetmap.org/ and click export
number_slider = Slider(51.6155, range=0..100)
createdictionary = CreateDictionary(Keys="building", Values="stadium", Component="{ .CreateDictionary")
createdictionary_2 = CreateDictionary(Keys=panel, Values="park", Component="{ .CreateDictionary")
createdictionary_3 = CreateDictionary(Keys="highway", Component="{ .CreateDictionary")
relation = Relation(Keyvalues=createdictionary, Component="BH.oM.OpenStreetMap.Relation")
way = Way(Keyvalues=createdictionary_2, Component="BH.oM.OpenStreetMap.Way")
way_2 = Way(Keyvalues=createdictionary_3, Component="BH.oM.OpenStreetMap.Way")
boundingbox = BoundingBox(
    North=number_slider,
    South=Slider(51.5933, range=0..100),
    East=Slider(-0.0279, range=-180..1),
    West=Slider(-0.0953, range=-180..1),
    Component="BH.oM.OpenStreetMap.BoundingBox")
querybuilder = QueryBuilder(Region=boundingbox, Elements=way, Component="{ .QueryBuilder")
querybuilder_2 = QueryBuilder(Region=boundingbox, Elements=way_2, Component="{ .QueryBuilder")
querybuilder_3 = QueryBuilder(Region=boundingbox, Elements=relation, Component="{ .QueryBuilder")
explode = Explode(Object=querybuilder_2, Component="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")  # -> QueryString, BHoM_Guid, Name, Fragments, Tags, CustomData
explode_2 = Explode(Object=querybuilder_3, Component="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")  # -> QueryString, BHoM_Guid, Name, Fragments, Tags, CustomData
explode_3 = Explode(Object=querybuilder, Component="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")  # -> QueryString, BHoM_Guid, Name, Fragments, Tags, CustomData

# ----
# ENABLE ONE BY ONE TO QUERY OSM
getrequest = GetRequest(Uri=explode.QueryString, Component="{ .GetRequest")  # disabled
# CAN BE SLOW
getrequest_2 = GetRequest(Uri=explode_3.QueryString, Component="{ .GetRequest")  # disabled
getrequest_3 = GetRequest(Uri=explode_2.QueryString, Component="{ .GetRequest")  # disabled

toelementcontainer = ToElementContainer(OpenStreetMapQueryJSONResult=getrequest, Component="{ .ToElementContainer")
toelementcontainer_2 = ToElementContainer(OpenStreetMapQueryJSONResult=getrequest_3, Component="{ .ToElementContainer")
toelementcontainer_3 = ToElementContainer(OpenStreetMapQueryJSONResult=getrequest_2, Component="{ .ToElementContainer")
explode_4 = Explode(Object=toelementcontainer_3, Component="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")  # -> Nodes, Ways, BHoM_Guid, Name, Fragments, Tags, CustomData
explode_5 = Explode(Object=toelementcontainer_2, Component="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")  # -> Nodes, Ways, BHoM_Guid, Name, Fragments, Tags, CustomData
explode_6 = Explode(Object=toelementcontainer, Component="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")  # -> Nodes, Ways, BHoM_Guid, Name, Fragments, Tags, CustomData
toutmpolyline = ToUTMPolyline(Way=explode_6.Ways, Component="{ .ToUTMPolyline")
toutmpolyline_2 = ToUTMPolyline(Way=explode_4.Ways, Component="{ .ToUTMPolyline")
toutmpolyline_3 = ToUTMPolyline(Way=explode_5.Ways, Component="{ .ToUTMPolyline")
curve = Curve(toutmpolyline_2)
boundary_surfaces = BoundarySurfaces(Edges=curve)
