# Grasshopper definition SearchBoundingBox2.gh (Grasshopper 1.0.7)
# plug-ins: BH.UI.Grasshopper

# Find the universities within the OSM area tagged as Bath
panel = Panel("name")
# Find the admin boundary of Bath within a bounding box
# Good place for finding the boundary values is https://www.openstreetmap.org/ and click export
number_slider = Slider(51.4281, range=0..100)
createdictionary = CreateDictionary(Keys=panel, Values="Bath", Component="{ .CreateDictionary")
createdictionary_2 = CreateDictionary(Keys="building", Values="university", Component="{ .CreateDictionary")
relation = Relation(Keyvalues=createdictionary, Component="BH.oM.OpenStreetMap.Relation")
relation_2 = Relation(Keyvalues=createdictionary_2, Component="BH.oM.OpenStreetMap.Relation")
way = Way(Keyvalues=createdictionary_2, Component="BH.oM.OpenStreetMap.Way")
taggedarea = TaggedArea(KeyValues=createdictionary, Component="BH.oM.OpenStreetMap.TaggedArea")
boundingbox = BoundingBox(
    North=number_slider,
    South=Slider(51.3336, range=0..100),
    East=Slider(-2.2302, range=-180..1),
    West=Slider(-2.4997, range=-180..1),
    Component="BH.oM.OpenStreetMap.BoundingBox")
querybuilder = QueryBuilder(Region=boundingbox, Elements=relation, Component="{ .QueryBuilder")
querybuilder_2 = QueryBuilder(Region=taggedarea, Elements=[way, relation_2], Component="{ .QueryBuilder")
explode = Explode(Object=querybuilder, Component="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")  # -> QueryString, BHoM_Guid, Name, Fragments, Tags, CustomData
explode_2 = Explode(Object=querybuilder_2, Component="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")  # -> QueryString, BHoM_Guid, Name, Fragments, Tags, CustomData
httpadapter = HTTPAdapter(Component="{ ..ctor")

getrequest = GetRequest(BaseUrl=explode.QueryString, Component="{ .GetRequest")
pull = Pull(
    Adapter=httpadapter,
    Request=getrequest,
    PullType="{ \"_t\" : \"System.Enum\", \"TypeName\" : { \"_t\" : \"System.Type\", \"Name\" : \"BH.oM.Adapter.PullType\" }, \"Value\" : \"AdapterDefault\" }",
    Active=Toggle(False),
    Component="{ .Pull")

getrequest_2 = GetRequest(BaseUrl=explode_2.QueryString, Component="{ .GetRequest")
pull_2 = Pull(
    Adapter=httpadapter,
    Request=getrequest_2,
    PullType="{ \"_t\" : \"System.Enum\", \"TypeName\" : { \"_t\" : \"System.Type\", \"Name\" : \"BH.oM.Adapter.PullType\" }, \"Value\" : \"AdapterDefault\" }",
    Active=Toggle(False),
    Component="{ .Pull")

toelementcontainer = ToElementContainer(QueryResults=pull, Component="{ .ToElementContainer")
toelementcontainer_2 = ToElementContainer(QueryResults=pull_2, Component="{ .ToElementContainer")
explode_3 = Explode(Object=toelementcontainer, Component="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")  # -> Nodes, Ways, Relations, BHoM_Guid, Name, Fragments, Tags, CustomData
explode_4 = Explode(Object=toelementcontainer_2, Component="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")  # -> Nodes, Ways, Relations, BHoM_Guid, Name, Fragments, Tags, CustomData
toutmpolyline = ToUTMPolyline(Way=explode_3.Ways, GridZone=0, Component="{ .ToUTMPolyline")
toutmpolyline_2 = ToUTMPolyline(Way=explode_4.Ways, GridZone=0, Component="{ .ToUTMPolyline")
