# Grasshopper definition SearchCentreRadius.gh (Grasshopper 1.0.7)
# plug-ins: BH.UI.Grasshopper

# Searching around the Aviva Stadium for bars,pubs and cafes plus all kinds of highway
number_slider = Slider(53.3352318, range=0..100)
# Full OSM feature list https://wiki.openstreetmap.org/wiki/Map_Features
number_slider_2 = Slider(-6.228456, range=-180..10)
number_slider_3 = Slider(1000, range=0..1000)
# Empty string for value defines a search for all types of highway
panel = Panel("leisure")
# Searching here for the same tags in both Way and Relation
panel_2 = Panel("stadium")
node = Node(Latitude=number_slider, Longitude=number_slider_2, Component="{ .Node")
createobject = CreateObject(Component="{ \"SelectedItem\" : null, \"InputParams\" : [], \"OutputParams\" : [], \"BHoM_Guid\" : \"7404e3ba-9596-4871-8fb8-5a5aad90159d\" }")
createdictionary = CreateDictionary(Keys=panel, Values=panel_2, Component="{ .CreateDictionary")
createdictionary_2 = CreateDictionary(Keys="amenity", Values="bar", Component="{ .CreateDictionary")
createdictionary_3 = CreateDictionary(Keys="amenity", Values="pub", Component="{ .CreateDictionary")
createdictionary_4 = CreateDictionary(Keys="amenity", Values="cafe", Component="{ .CreateDictionary")
createdictionary_5 = CreateDictionary(Keys="highway", Component="{ .CreateDictionary")
toutmpoint = ToUTMPoint(Node=node, Component="{ .ToUTMPoint")
centreradius = CentreRadius(Centre=node, Radius=number_slider_3, Component="BH.oM.OpenStreetMap.CentreRadius")
point = Point(toutmpoint)
way = Way(Keyvalues=createdictionary, Component="{ .Way")
relation = Relation(Keyvalues=createdictionary, Component="{ .Relation")
way_2 = Way(Keyvalues=createdictionary_5, Component="{ .Way")
node_2 = Node(Keyvalues=[createdictionary_2, createdictionary_3, createdictionary_4], Component="{ .Node")
circle = Circle(Plane=point, Radius=number_slider_3)
querybuilder = QueryBuilder(Region=centreradius, Elements=node_2, Component="{ .QueryBuilder")
querybuilder_2 = QueryBuilder(Region=centreradius, Elements=way_2, Component="{ .QueryBuilder")
querybuilder_3 = QueryBuilder(Region=centreradius, Elements=[way, relation], Component="{ .QueryBuilder")
explode = Explode(Object=querybuilder, Component="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")  # -> QueryString, BHoM_Guid, Name, Fragments, Tags, CustomData
explode_2 = Explode(Object=querybuilder_3, Component="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")  # -> QueryString, BHoM_Guid, Name, Fragments, Tags, CustomData
explode_3 = Explode(Object=querybuilder_2, Component="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")  # -> QueryString, BHoM_Guid, Name, Fragments, Tags, CustomData
# Check the search in http://overpass-turbo.eu/
panel_3 = Panel("http://overpass-turbo.eu/s/Omp")

# ----
# ENABLE ONE BY ONE TO QUERY
getrequest = GetRequest(Uri=explode.QueryString, Component="{ .GetRequest")  # disabled
getrequest_2 = GetRequest(Uri=explode_3.QueryString, Component="{ .GetRequest")  # disabled
# CAN BE SLOW
getrequest_3 = GetRequest(Uri=explode_2.QueryString, Component="{ .GetRequest")  # disabled

panel_4 = Panel("http://overpass-turbo.eu/s/Omr")
toelementcontainer = ToElementContainer(OpenStreetMapQueryJSONResult=getrequest, Component="{ .ToElementContainer")
toelementcontainer_2 = ToElementContainer(OpenStreetMapQueryJSONResult=getrequest_2, Component="{ .ToElementContainer")
toelementcontainer_3 = ToElementContainer(OpenStreetMapQueryJSONResult=getrequest_3, Component="{ .ToElementContainer")
explode_4 = Explode(Object=toelementcontainer, Component="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")  # -> Nodes, Ways, BHoM_Guid, Name, Fragments, Tags, CustomData
explode_5 = Explode(Object=toelementcontainer_3, Component="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")  # -> Nodes, Ways, BHoM_Guid, Name, Fragments, Tags, CustomData
explode_6 = Explode(Object=toelementcontainer_2, Component="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")  # -> Nodes, Ways, BHoM_Guid, Name, Fragments, Tags, CustomData
explode_7 = Explode(Object=explode_5.Ways, Component="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")  # -> Nodes, OsmID, NodeOsmIds, KeyValues, BHoM_Guid, Name, Fragments, Tags, CustomData
toutmpoint_2 = ToUTMPoint(Node=explode_4.Nodes, Component="{ .ToUTMPoint")
explode_8 = Explode(Object=explode_4.Nodes, Component="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")  # -> Latitude, Longitude, OsmID, KeyValues, BHoM_Guid, Name, Fragments, Tags, CustomData
toutmpolyline = ToUTMPolyline(Way=explode_5.Ways, Component="{ .ToUTMPolyline")
toutmpolyline_2 = ToUTMPolyline(Way=explode_6.Ways, Component="{ .ToUTMPolyline")
point_2 = Point(toutmpoint_2)
curve = Curve(toutmpolyline)
point_on_curve = PointOnCurve(curve, parameter=0.5)
getproperty = GetProperty(Obj=explode_7.KeyValues, PropName="name", Component="{ .GetProperty")
getproperty_2 = GetProperty(Obj=explode_8.KeyValues, PropName="amenity", Component="{ .GetProperty")
text_tag_3d = TextTag3D(Location=point_on_curve, Text=getproperty, Size=Slider(27, range=0..1000), Justification=7)
text_tag_3d_2 = TextTag3D(Location=point_2, Text=getproperty_2, Size=Slider(27, range=0..1000), Justification=7)
