# Grasshopper definition SearchInPolygon.gh (Grasshopper 1.0.7)
# plug-ins: BH.UI.Grasshopper

# Searching for ...in a Polygon around Dublin
panel = Panel("""53.347746
53.347746
53.34867
53.349595
53.350519
53.351443
53.352367
53.352367
53.353276
53.3541839
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""")
panel_2 = Panel("""-6.251975
-6.251975
-6.251494
-6.2510139
-6.250533
-6.250052
-6.249572
-6.249572
-6.248484
-6.247397
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""")
cull_pattern = CullPattern(List=panel, CullPattern=[False, False, False, True])
cull_pattern_2 = CullPattern(List=panel_2, CullPattern=[False, False, False, True])
createdictionary = CreateDictionary(Keys="waterway", Values="river", Component="{ .CreateDictionary")
createdictionary_2 = CreateDictionary(Keys="leisure", Values="sport", Component="{ .CreateDictionary")
createdictionary_3 = CreateDictionary(Keys="waterway", Values="stream", Component="{ .CreateDictionary")
createdictionary_4 = CreateDictionary(Keys="waterway", Values="canal", Component="{ .CreateDictionary")
node = Node(Latitude=cull_pattern, Longitude=cull_pattern_2, Component="{ .Node")
way = Way(Keyvalues=[createdictionary_3, createdictionary_4, createdictionary], Component="{ .Way")
way_2 = Way(Keyvalues=createdictionary_2, Component="{ .Way")
polygon = Polygon(Nodes=node, Component="BH.oM.OpenStreetMap.Polygon")
nodetoutmpoint = NodeToUTMPoint(Node=node, Component="{ .NodeToUTMPoint")
point = Point(nodetoutmpoint)
querybuilder = QueryBuilder(Region=polygon, Ways=way, Component="{ .QueryBuilder")
querybuilder_2 = QueryBuilder(Region=polygon, Ways=way_2, Component="{ .QueryBuilder")
polyline = PolyLine(Vertices=point, Closed=Toggle(True))
explode = Explode(Object=querybuilder, Component="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")  # -> QueryString, BHoM_Guid, Name, Fragments, Tags, CustomData
explode_2 = Explode(Object=querybuilder_2, Component="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")  # -> QueryString, BHoM_Guid, Name, Fragments, Tags, CustomData

# ----
# ENABLE ONE BY ONE TO QUERY
getrequest = GetRequest(Uri=explode.QueryString, Component="{ .GetRequest")
getrequest_2 = GetRequest(Uri=explode_2.QueryString, Component="{ .GetRequest")

elementcontainer = ElementContainer(OSMQueryJSONResult=getrequest_2, Component="{ .ElementContainer")
elementcontainer_2 = ElementContainer(OSMQueryJSONResult=getrequest, Component="{ .ElementContainer")
explode_3 = Explode(Object=elementcontainer, Component="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")  # -> Nodes, Ways, BHoM_Guid, Name, Fragments, Tags, CustomData
explode_4 = Explode(Object=elementcontainer_2, Component="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")  # -> Nodes, Ways, BHoM_Guid, Name, Fragments, Tags, CustomData
waytoutmpolyline = WayToUTMPolyline(Way=explode_3.Ways, Component="{ .WayToUTMPolyline")
waytoutmpolyline_2 = WayToUTMPolyline(Way=explode_4.Ways, Component="{ .WayToUTMPolyline")
